% Simulink data dictionary vehicle_params.sldd

vehicle = struct(
  m=14193,
  ms=12487,
  muf=706,
  mur=1000,
  Ixx=24201,
  Izz=34917,
  Ixz=4200,
  h=0.83,
  hu=0.53,
  rf=1.15,
  rr=1.15,
  lf=1.95,
  lr=1.54,
  lw=0.93,
  w=3.49,
  kf=380000,
  kr=684000,
  bf=100000,
  br=100000,
  ktf=2060000,
  ktr=3337000,
  Cf=582000,
  Cr=783000,
  tAf=2.4076,
  tBf=0.6593,
  cf=0.8931,
  tAr=2.8629,
  tBr=0.4113,
  cr=0.7651,
  kAO_f=10730,
  kAO_r=15480,
  Df=32,
  Dr=34,
  mu=1,
  g=9.81,
  v=19.44444,
  SSF=1.120482,
  name="Chevrolet Blazer 2001",
  reference="Khalil et al. (2019), SAE 2019-01-0003",
  dof=14)

MAR = struct(f=struct(phi=85413.58, phi_u=-311909.2), r=struct(phi=124554.5, phi_u=-866975.7))

A_ativo = Simulink.Parameter([-0 -1 0.1593792 -0 -3.223437 -5.222825
 -0 -2.023954e-17 0.5104787 -0 -10.32441 -16.72828
 0 2.138241e-33 -1.253589e-16 1 -8.982497e-16 6.57436e-15
 0 -1.682629e-16 4.243901 0 -85.83268 -139.0718
 -0 -2.014012e-18 4.667701 2 -21.51855 -0.4445263
 -0 -3.233922e-18 8.104759 2 -0.3886032 -32.11789])  % State matrix (6x6) @ 70.0 km/h

B_ativo = Simulink.Parameter([7.055416e-06 6.397358e-06 3.135137e-06 4.702705e-06
 6.683882e-05 -3.52202e-05 1.004159e-05 1.506238e-05
 2.220446e-21 -1.110223e-21 -2.220446e-21 -4.440892e-21
 9.138357e-05 7.3861e-05 8.348146e-05 0.0001252222
 1.21005e-05 5.444934e-07 2.668385e-07 1.040026e-05
 8.505696e-07 1.227124e-05 1.037796e-05 1.056694e-05])  % Input matrix (6x4): [δf, δr, Tf, Tr]

C_ativo = Simulink.Parameter([1 0 0 0 0 0
 0 1 0 0 0 0
 0 0 1 0 0 0
 0 0 0 1 0 0
 0 0 0 0 1 0
 0 0 0 0 0 1])  % Output matrix (identity)

D_ativo = Simulink.Parameter(repmat(0, 6, 4))  % Feedthrough matrix (zeros)
PID_params = struct(Kp=23.15, Ki=10.2, Kd=5.4, Tm_max=15000)

LQR_params = struct(
  K=repmat(0, 2, 4),
  Q=[10000000000 0 0 0; 0 50000000 0 0; 0 0 20000000 0; 0 0 0 20000000],
  R=[0.01 0; 0 0.01],
  T=[0 0 1 0 0 0
   0 0 0 1 0 0
   0 0 0 0 1 0
   0 0 0 0 0 1])

ARB_Mode = Simulink.Parameter(2)  % 1=Passive, 2=PID, 3=MPC